# Grasshopper definition Envelope Control_V14.gh (Grasshopper 0.9.76)
# plug-ins: Human UI, Firefly.Core

xz = XZPlane(Origin=Point(0, 0, 0))
arc = Arc(Plane=xz, Radius=Slider(100, range=0..100), Angle=Domain(0, 3.141592654))  # -> Arc, Length

# ----
# Camera Parameters UI
panel = Panel("Sensor Height")
textbox = CreateTextBox(Label="Size of Image file MB", DefaultText="82", UpdateButton=True, showLabel=True)
textbox_2 = CreateTextBox(Label="Sensor Length", DefaultText="35.9", UpdateButton=True, showLabel=True)
textbox_3 = CreateTextBox(Label=panel, DefaultText="24", UpdateButton=True, showLabel=True)
values = ValueListener(Elements=textbox_2, SomeProperty=True)  # -> Values, Indices
values_2 = ValueListener(Elements=textbox_3, SomeProperty=True)  # -> Values, Indices
values_3 = ValueListener(Elements=textbox, SomeProperty=True)  # -> Values, Indices
merge = Merge(Data1=flatten(textbox_2), Data2=flatten(textbox_3), Data3=flatten(textbox))
expander = CreateExpander(UIElements=merge, Open=True)

# ----
# Origin
number_slider = Slider(74, range=0..100)
sph = Sphere(Base=PlaneXY(0, 0, 0), Radius=number_slider)

# ----
# Turntable
# Representation of the turntable
number_slider_2 = Slider(-10, range=-20..0)
cir = Circle(Plane=PlaneXY(0, 0, 0), Radius=Slider(150, range=0..1000))
Z = UnitZ(Factor=number_slider_2)
extr = Extrude(Base=cir, Direction=Z)
cap = CapHoles(Brep=extr)

srf = Surface(<surface referenced from the Rhino model>)
division = Division(A="30", B=0.0025)

label = CreateLabel(LabelSize=18, Justification=0)

# ----
# Cylinder Representation
bottom_radius = Slider(100, range=1..150)
top_radius = Slider(100, range=1..150)
height = Slider(350, range=0..350)
xy = XYPlane(Origin=Point(0, 0, 0))

# ----
# Dome Lists
# Cylinder Lists
# Sphere Lists
slider = CreateSlider(Slider=bottom_radius, ShowBounds=False, showLabel=True, ShowTicks=False, ShowTooltip=False, ShowValLabel=True)
slider_2 = CreateSlider(Slider=top_radius, ShowBounds=False, showLabel=True, ShowTicks=False, ShowTooltip=False, ShowValLabel=True)
slider_3 = CreateSlider(Slider=height, ShowBounds=False, showLabel=True, ShowTicks=False, ShowTooltip=False, ShowValLabel=True)
values_4 = ValueListener(Elements=slider, SomeProperty=True)  # -> Values, Indices
values_5 = ValueListener(Elements=slider_2, SomeProperty=True)  # -> Values, Indices
values_6 = ValueListener(Elements=slider_3, SomeProperty=True)  # -> Values, Indices
merge_2 = Merge(Data1=flatten(slider), Data2=flatten(slider_2), Data3=flatten(slider_3))

pt = ConstructPoint(XCoordinate=0, YCoordinate=0, ZCoordinate=values_6.Values)
xy_2 = XYPlane(Origin=pt)
cir_2 = Circle(Plane=xy, Radius=values_4.Values)
cir_3 = Circle(Plane=xy_2, Radius=values_5.Values)
merge_3 = Merge(Data1=cir_3, Data2=cir_2)
loft = Loft(Curves=merge_3, Options={Adjust=False, Closed=False, LoftEnds=0, LoftSimp=0, LoftType=0, Rebuild=10, Refit=0.01})
srf_2 = Surface(loft)

# ----
# Dome Representation
envelope_height = Slider(250, range=0..250)
base_radius = Slider(150, range=0..150)
arc_width = Slider(150, range=1..150)
arc_height = Slider(250, range=50..250)

slider_4 = CreateSlider(Slider=arc_width, ShowBounds=False, showLabel=True, ShowTicks=False, ShowTooltip=False, ShowValLabel=True)
slider_5 = CreateSlider(Slider=arc_height, ShowBounds=False, showLabel=True, ShowTicks=False, ShowTooltip=False, ShowValLabel=True)
slider_6 = CreateSlider(Slider=envelope_height, ShowBounds=False, showLabel=True, ShowTicks=False, ShowTooltip=False, ShowValLabel=True)
# Construct envelope + UI
slider_7 = CreateSlider(Slider=base_radius, ShowBounds=False, showLabel=True, ShowTicks=False, ShowTooltip=False, ShowValLabel=True)
values_7 = ValueListener(Elements=slider_4, SomeProperty=True)  # -> Values, Indices
values_8 = ValueListener(Elements=slider_5, SomeProperty=True)  # -> Values, Indices
values_9 = ValueListener(Elements=slider_6, SomeProperty=True)  # -> Values, Indices
values_10 = ValueListener(Elements=slider_7, SomeProperty=True)  # -> Values, Indices

# ----
# Sphere Representation
height_2 = Slider(100, range=0..150)
radius = Slider(75, range=1..150)

multiplication = Multiplication(A=height_2, B=2.5)

slider_8 = CreateSlider(Slider=height_2, ShowBounds=False, showLabel=True, ShowTicks=False, ShowTooltip=False, ShowValLabel=True)
slider_9 = CreateSlider(Slider=radius, ShowBounds=False, showLabel=True, ShowTicks=False, ShowTooltip=False, ShowValLabel=True)
values_11 = ValueListener(Elements=slider_9, SomeProperty=True)  # -> Values, Indices
values_12 = ValueListener(Elements=slider_8, SomeProperty=True)  # -> Values, Indices
merge_4 = Merge(Data1=flatten(slider_9), Data2=flatten(slider_8))

pt_2 = ConstructPoint(XCoordinate=0, YCoordinate=0, ZCoordinate=values_12.Values)
xy_3 = XYPlane(Origin=pt_2)
sph_2 = Sphere(Base=xy_3, Radius=values_11.Values)
srf_3 = Surface(sph_2)

label_2 = CreateLabel(LabelText="what", LabelSize=18, Justification=0)
label_3 = CreateLabel(LabelText="what", LabelSize=18, Justification=0)
setlabel = SetLabelContents(LabelToModify=label_2, NewLabelContents="2. Name your file")
setlabel_2 = SetLabelContents(LabelToModify=label_3, NewLabelContents="1. Select File Destination")
label_4 = CreateLabel(LabelText="what", LabelSize=18, Justification=0)
label_5 = CreateLabel(LabelText="what", LabelSize=18, Justification=0)
label_6 = CreateLabel(LabelText="what", LabelSize=18, Justification=0)
panel_2 = Panel(label_6)
panel_3 = Panel(label_4)

# ----
# Generate Code
# for saving
panel_4 = Panel("Pick Folder")
filepicker = CreateFilePicker(ButtonLabelText=panel_4, DialogType=2, MustExist=True, Filter="All Files|*.*")
values_13 = ValueListener(Elements=filepicker, SomeProperty=True)  # -> Values, Indices
textbox_4 = CreateTextBox(DefaultText="Scanner_Code_", UpdateButton=False, showLabel=True)
values_14 = ValueListener(Elements=textbox_4, SomeProperty=True)  # -> Values, Indices
settextbox = SetTextBoxContents(TextBoxToModify=textbox_4, NewTextBoxContents="Scanner_Code_")
button = CreateButton(ButtonName="          Write File          ", ButtonStyle=0)
values_15 = ValueListener(Elements=button, SomeProperty=True)  # -> Values, Indices
panel_5 = Panel(values_13.Values)
merge_5 = Merge(
    Data1=flatten(label_3),
    Data2=flatten(filepicker),
    Data3=flatten(label_2),
    Data4=flatten(textbox_4),
    Data5=flatten(label_5),
    Data6=flatten(label_6),
    Data7=flatten(label_4),
    Data8=flatten(button),
    Data9=flatten(label))
# How to Read this Document:
# 
# Grasshopper is an node-based system for algormithmic design. Each node represents a different process or transformation, many of them are self explanatory.
# By hovering over the node you will see a description of what it does. Nodes have inputs and outputs and you can see a description of what they do by hovering
# over it. Additionally you can right click and click on help for a sheet which describes each item. By right clicking you can toggle whether the output of the node is
# displayed in the rhino viewport. Many of the nodes in the definition are not displaying in the viewport. This may be due to being an intermediate step and not
# neccesary to the fial outcome.
panel_6 = Panel("3. Generate")

concat = Concatenate(FragmentA="File named \"", FragmentC=values_14.Values, FragmentD="\" has been written to ", FragmentB=values_13.Values)

pt_3 = ConstructPoint(XCoordinate=0, YCoordinate=values_7.Values, ZCoordinate=values_8.Values)
pt_4 = ConstructPoint(XCoordinate=0, YCoordinate=values_10.Values, ZCoordinate=0)
pt_5 = ConstructPoint(XCoordinate=0, YCoordinate=0, ZCoordinate=values_9.Values)
merge_6 = Merge(Data1=pt_4, Data2=pt_3, Data3=pt_5)
nurbs = NurbsCurve(Vertices=merge_6, Degree=2, Periodic=False)  # -> Curve, Length, Domain

# ----
# Dispatch Surface
# Dispatch Offset
# Dispatch Menus
# Envelope Construct UI
panel_7 = Panel("Distrobution type")
list = ValueList({"Dome": 1, "Cylinder": 2, "Sphere": 3}, selected="Dome")
panel_8 = Panel(list)
pulldown = CreatePulldownMenu(Label=panel_7, ListItems=list, showLabel=True)
panel_9 = Panel(pulldown)
values_16 = ValueListener(Elements=pulldown, SomeProperty=True)  # -> Values, Indices
panel_10 = Panel(values_16.Values)
expression = Expression(x=panel_10, Expression="If (( x = \"Cylinder\" ), 1, 0 )")
expression_2 = Expression(x=panel_10, Expression="If (( x = \"Cylinder\" ), 1, 0 )")
expression_3 = Expression(x=panel_10, Expression="If (( x = \"Cylinder\" ), 1, 0 )")
expression_4 = Expression(x=panel_10, Expression="If (( x = \"Cylinder\" ), 1, 0 )")
expression_5 = Expression(x=panel_10, Expression="If (( x = \"Sphere\" ), 1, 0 )")
expression_6 = Expression(x=panel_10, Expression="If (( x = \"Sphere\" ), 1, 0 )")
expression_7 = Expression(x=panel_10, Expression="If (( x = \"Sphere\" ), 1, 0 )")
expression_8 = Expression(x=panel_10, Expression="If (( x = \"Sphere\" ), 1, 0 )")
expression_9 = Expression(x=panel_10, Expression="If (( x = \"Dome\" ), 1, 0 )")
expression_10 = Expression(x=panel_10, Expression="If (( x = \"Dome\" ), 1, 0 )")
expression_11 = Expression(x=panel_10, Expression="If (( x = \"Dome\" ), 1, 0 )")
expression_12 = Expression(x=panel_10, Expression="If (( x = \"Dome\" ), 1, 0 )")
dispatch = Dispatch(List=merge_2, DispatchPattern=expression)  # -> ListA, ListB
dispatch_2 = Dispatch(List=merge_4, DispatchPattern=expression_5)  # -> ListA, ListB
dispatch_3 = Dispatch(List=envelope_height, DispatchPattern=expression_10)  # -> ListA, ListB
dispatch_4 = Dispatch(List=height, DispatchPattern=expression_2)  # -> ListA, ListB
dispatch_5 = Dispatch(List=multiplication, DispatchPattern=expression_6)  # -> ListA, ListB
dispatch_6 = Dispatch(List=srf_2, DispatchPattern=expression_3)  # -> ListA, ListB
dispatch_7 = Dispatch(List=srf_3, DispatchPattern=expression_7)  # -> ListA, ListB
dispatch_8 = Dispatch(List=base_radius, DispatchPattern=expression_12)  # -> ListA, ListB
dispatch_9 = Dispatch(List=values_4.Values, DispatchPattern=expression_4)  # -> ListA, ListB
dispatch_10 = Dispatch(List=values_11.Values, DispatchPattern=expression_8)  # -> ListA, ListB
# Dispatch height
merge_7 = Merge(Data1=dispatch_3.ListA, Data2=dispatch_4.ListA, Data3=dispatch_5.ListA)
merge_8 = Merge(Data1=dispatch_8.ListA, Data2=dispatch_9.ListA, Data3=dispatch_10.ListA)

# ----
# 3D view + Assembly
number_slider_3 = Slider(0, range=-10000..10000)
toggle = BooleanToggle(False)
pt_6 = ConstructPoint(XCoordinate=number_slider_3, YCoordinate=Slider(0, range=0..100), ZCoordinate=Slider(100, range=0..100))
pt_7 = ConstructPoint(XCoordinate=Slider(5000, range=0..5000), YCoordinate=Slider(0, range=0..1000), ZCoordinate=Slider(100, range=0..1000))
sph_3 = Sphere(Base=PlaneXY(0, 0, 0), Radius=1)
swatch = ColourSwatch(SwatchColor=RGBA(222, 222, 222, 113))
_3dview = Create3DView(MeshToDisplay=sph_3, MeshColors=swatch, ViewWidth=Slider(800, range=0..1000), ViewHeight=Slider(400, range=0..1000))
set3dviewprops = Set3DViewProperties(
    _3DView=_3dview,
    ShowViewCube=toggle,
    AllowPan=toggle,
    AllowMove=toggle,
    AllowRotation=toggle,
    PerspectiveParallel=Toggle(True),
    CameraLocation=pt_7,
    CameraTarget=pt_6)

merge_9 = Merge(
    Data1=flatten(slider_7),
    Data2=flatten(slider_4),
    Data3=flatten(slider_5),
    Data4=flatten(slider_6),
    Data5=flatten(_3dview))

dispatch_11 = Dispatch(List=merge_9, DispatchPattern=expression_9)  # -> ListA, ListB
merge_10 = Merge(Data1=dispatch_11.ListA, Data2=dispatch.ListA, Data3=dispatch_2.ListA)

merge_11 = Merge(Data1=flatten(pulldown), Data2=flatten(merge_10), Data3=flatten(_3dview))

# ----
# Frames UI
panel_11 = Panel("5")
list_2 = ValueList({"90", "55", "35"}, selected="35")
sph_4 = Sphere(Base=PlaneXY(0, 0, 0), Radius=1)
pulldown_2 = CreatePulldownMenu(Label="Lens", ListItems=list_2, showLabel=True)
_3dview_2 = Create3DView(
    MeshToDisplay=sph_4,
    MeshColors=ColourSwatch(SwatchColor=RGBA(222, 222, 222, 166)),
    ViewWidth=Slider(1300, range=0..1300),
    ViewHeight=Slider(440, range=0..1000))
values_17 = ValueListener(Elements=pulldown_2, SomeProperty=True)  # -> Values, Indices
toggle_2 = BooleanToggle(False)
set3dviewprops_2 = Set3DViewProperties(_3DView=_3dview_2, ShowViewCube=toggle_2, AllowPan=toggle_2)

panel_12 = Panel(["1. Envelope Construct", "2. Frames", panel_6])
getscreen = GetScreenDimensions()  # -> Width, Height
launchwin = LaunchWindow(
    Show=Toggle(True),
    Name="Scanner Software",
    Width=getscreen.Width,
    Height=getscreen.Height,
    ChildStatus=1,
    EnableHorizScroll=False)
winprops = SetWindowProperties(
    Window=launchwin,
    Theme=0,
    ShowTitleBar=True,
    BackgroundColor=ColourSwatch(SwatchColor=RGB(255, 255, 255)),
    ScaleFactor=1)

# ---- group: Save Scatter Data
file_name = Text(values_14.Values)
write_txt = Boolean(values_15.Values)
concat_2 = Concatenate(FragmentC=panel_5, FragmentD="\", FragmentA=file_name, FragmentB=".txt")
path = FilePath(concat_2)
P = Boolean(False)
clear = Boolean(Button())

# ----
panel_13 = Panel(write_txt)
expression_13 = Expression(x=flatten(panel_13), Expression="If (( x = \"True\" ), 1, 0 )")
expression_14 = Expression(x=flatten(panel_13), Expression="If (( x = \"False\"  ), 1, 0 )")
dispatch_12 = Dispatch(List=flatten(""), DispatchPattern=expression_14)  # -> ListA, ListB
dispatch_13 = Dispatch(List=flatten(concat), DispatchPattern=expression_13)  # -> ListA, ListB
merge_12 = Merge(Data1=dispatch_12.ListA, Data2=dispatch_13.ListA)
log = DataLog(IncomingData=merge_12, ResetLog=Button(), StartRecording=True, WrapValues=False, RecordingLength=0)
setlabel_3 = SetLabelContents(LabelToModify=label, NewLabelContents=log)

# ----
# If statements with boolean switch to allow data flow for correct minimum focus data stream
# Reads camera length value and then sets the minumun focus distance for each lens type
panel_14 = Panel("1")

# ----
# Input Parameters
# Number of Images
# Select Lens
# Approx Time to Scan
# Sensor Length
# Sensor Height
# Size of image file mb
# Image Length (pixels)
# Approx Size of Scan MB
# Image Height (pixels)
image_overlay = Slider(70, range=5..90)
panel_15 = Panel(values_17.Values)
panel_16 = Panel("5304")
panel_17 = Panel(values_3.Values)
panel_18 = Panel(values.Values)
panel_19 = Panel(values_2.Values)
panel_20 = Panel("7952")

repeat = RepeatData(Data=panel_15, Length=panel_14)
panel_21 = Panel(repeat)
int = Integer(panel_21)
expression_15 = Expression(x=int, y=int, Expression="If ( x=35, 1, 0 )")
expression_16 = Expression(x=int, y=int, Expression="If ( x=55, 1, 0 )")
expression_17 = Expression(x=int, y=int, Expression="If ( x=90, 1, 0 )")
dispatch_14 = Dispatch(List="350", DispatchPattern=expression_15)  # -> ListA, ListB
dispatch_15 = Dispatch(List="500", DispatchPattern=expression_16)  # -> ListA, ListB
dispatch_16 = Dispatch(List="280", DispatchPattern=expression_17)  # -> ListA, ListB
merge_13 = Merge(Data1=dispatch_14.ListA, Data2=dispatch_15.ListA, Data3=dispatch_16.ListA)  # -> simplify(Result)
panel_22 = Panel(merge_13)

slider_10 = CreateSlider(
    Slider=image_overlay,
    SnapValue=panel_11,
    ShowBounds=False,
    showLabel=True,
    ShowTicks=False,
    ShowTooltip=False,
    ShowValLabel=True)
values_18 = ValueListener(Elements=slider_10, SomeProperty=True)  # -> Values, Indices
merge_14 = Merge(Data1=slider_10, Data2=pulldown_2, Data3=_3dview_2)
expander_2 = CreateExpander(UIElements=merge_14, Header="2. Frames", Open=True)

# ----
# Baseline Vert Calc
# Distance mm
# Focal Length mm
# Baseline Horiz Calc
# Distance mm
# Focal Length mm
panel_23 = Panel(panel_21)
panel_24 = Panel(panel_22)
panel_25 = Panel(panel_21)
panel_26 = Panel(panel_22)
expression_18 = Expression(x=panel_24, y=panel_25, z=panel_18, u=values_18.Values, Expression="((x/y)*z)*(1-(u/100))")
expression_19 = Expression(x=panel_26, y=panel_23, z=panel_19, u=values_18.Values, Expression="((x/y)*z)*(1-(u/100))")
panel_27 = Panel(expression_19)
panel_28 = Panel(expression_18)

merge_15 = Merge(
    Data1=flatten(slider_10),
    Data2=flatten(pulldown_2),
    Data3=flatten(textbox_2),
    Data4=flatten(textbox_3),
    Data5=flatten(textbox),
    Data6=flatten(_3dview_2))
tabs = TabbedView(TabNames=panel_12, Tab0=flatten(merge_11), Tab1=flatten(merge_15), Tab2=flatten(merge_5))
settab = SetTabbedView(TabbedView=tabs, TabNames=panel_12)
# Its fine that this has runtime errors,
#  cant use the set menu to work.
# Because its on the first step it doesnt
# matter that the whole window
# regenerates, not noticable.
addelems = AddElements(Window=launchwin, Elements=flatten(tabs), DoVLChecking=True)  # -> AddedElements, ElementNames

pt_8 = ConstructPoint(XCoordinate=0, YCoordinate=0, ZCoordinate=merge_7)
ln = Line(StartPoint=Point(0, 0, 0), EndPoint=pt_8)
brep = Brep()

# ----
# Surface Offset to minmum focus
# Coordinate Array Calculation
# Axis
# Creates curves on the
# interaction between the
# surface offset and the
# planes
# Draws rectanges to
# visualise where the
# frames are
# Line to set height
# of machine
# Places planes on points
# generated from vert baseline calc
# Divides axis by the values
#  given from basline vert calc
# Divides curve by the
# horizontal baseline calc
number_slider_4 = Slider(-80, range=-200..500)
line = Line(Line((0, 0, -60), (0, 0, 410)))
pt_9 = ConstructPoint(XCoordinate=0, YCoordinate=0, ZCoordinate=number_slider_4)
move = Move(Geometry=line, Motion=Vector(0, 0, 10))  # -> Geometry, Transform
divlength = DivideLength(Curve=move.Geometry, Length=panel_27)  # -> Points, Tangents, Parameters
pt_10 = ConstructPoint(XCoordinate=0, YCoordinate=0, ZCoordinate=Slider(450, range=-200..500))
ln_2 = Line(StartPoint=pt_9, EndPoint=pt_10)
dom = Domain(DomainStart=expr("-x/2", 1500), DomainEnd=expr("x/2", 1500))
dom_2 = Domain(DomainStart=expr("-x/2", 1500), DomainEnd=expr("x/2", 1500))
planesrf = PlaneSurface(Plane=divlength.Points, XSize=dom, YSize=dom_2)
dom_3 = Domain(DomainStart=expr("-x/2", panel_18), DomainEnd=expr("x/2", panel_18))
dom_4 = Domain(DomainStart=expr("-x/2", panel_19), DomainEnd=expr("x/2", panel_19))

revsrf = Revolution(Curve=nurbs.Curve, Axis=line, Domain=Domain(0, 6.283185307))
srf_4 = Surface(revsrf)

dispatch_17 = Dispatch(List=srf_4, DispatchPattern=expression_11)  # -> ListA, ListB
merge_16 = Merge(Data1=dispatch_17.ListA, Data2=dispatch_6.ListA, Data3=dispatch_7.ListA)
srf_5 = Surface(merge_16)

geo = Geometry([srf_5, cap])

set3dview = Set3DView(_3DView=_3dview, MeshToDisplay=flatten(geo), MeshColors=swatch)

offset = Offset(Surface=srf_5, Distance=panel_26, Retrim=True)
bbx = BrepBrep(BrepA=offset, BrepB=planesrf)  # -> Curves, Points
crv = Curve(bbx.Curves)
divlength_2 = DivideLength(Curve=crv, Length=panel_28)  # -> Points, Tangents, Parameters
cullpt = CullDuplicates(Points=flatten(divlength_2.Points), Tolerance=5, CullMode=1)  # -> Points, Indices, Valence
lng = ListLength(List=cullpt.Points)  # -> flatten(Length)
srf_cp = SurfaceClosestPoint(Point=cullpt.Points, Surface=offset)  # -> Point, UVPoint, Distance
multiplication_2 = Multiplication(A=lng, B=3)
multiplication_3 = Multiplication(A=lng, B=panel_17)
evalsrf = EvaluateSurface(Surface=offset, Point=srf_cp.UVPoint)  # -> Point, Normal, Frame
smtime = ConstructSmoothTime(Days=0, Hours=0, Minutes=0, Seconds=multiplication_2)
rectangle = Rectangle(Plane=evalsrf.Frame, XSize=dom_3, YSize=dom_4, Radius=0)  # -> Rectangle, Length

concat_3 = Concatenate(FragmentA="Approximate size of scan: ", FragmentB=multiplication_3, FragmentC=" MB")
concat_4 = Concatenate(FragmentA="Number of Images: ", FragmentB=lng)
concat_5 = Concatenate(FragmentA="Approximate time to scan: ", FragmentB=smtime)
panel_29 = Panel(concat_3)
panel_30 = Panel(concat_5)
panel_31 = Panel(concat_4)
setlabel_4 = SetLabelContents(LabelToModify=label_4, NewLabelContents=panel_29)
setlabel_5 = SetLabelContents(LabelToModify=label_5, NewLabelContents=panel_31)
setlabel_6 = SetLabelContents(LabelToModify=label_6, NewLabelContents=panel_30)

geo_2 = Geometry([rectangle.Rectangle, srf_5])
set3dview_2 = Set3DView(_3DView=_3dview_2, MeshToDisplay=flatten(geo_2))

lng_2 = ListLength(List=flatten(bbx.Curves))
divide = DivideCurve(Curve=ln, Count=lng_2, Kinks=False)  # -> Points, Tangents, Parameters
planesrf_2 = PlaneSurface(Plane=divide.Points, XSize=dom, YSize=dom_2)
bbx_2 = BrepBrep(BrepA=srf_5, BrepB=planesrf_2)  # -> Curves, Points
lng_3 = ListLength(List=flatten(bbx.Curves))
lng_4 = ListLength(List=flatten(divlength_2.Points))
division_2 = Division(A=lng_4, B=lng_3)
round = Round(Number=division_2)  # -> Nearest, Floor, Ceiling
divide_2 = DivideCurve(Curve=bbx.Curves, Count=round.Nearest, Kinks=False)  # -> flatten(Points), Tangents, Parameters
divide_3 = DivideCurve(Curve=bbx_2.Curves, Count=round.Nearest, Kinks=False)  # -> flatten(Points), Tangents, Parameters
srf_cp_2 = SurfaceClosestPoint(Point=divlength_2.Points, Surface=srf_5)  # -> Point, UVPoint, Distance
srf_cp_3 = SurfaceClosestPoint(Point=divide_3.Points, Surface=srf_5)  # -> Point, UVPoint, Distance
ln_3 = Line(StartPoint=divide_2.Points, EndPoint=divide_3.Points)
crvsrf = CurveOnSurface(UVCoordinates=srf_cp_3.UVPoint, Closed=False)  # -> Curve, Length, Domain

panel_32 = Panel(lng)
panel_33 = Panel(smtime)
panel_34 = Panel(multiplication_3)

srf_6 = Surface(srf_5)
srf_cp_4 = SurfaceClosestPoint(Point=divide_2.Points, Surface=srf_6)  # -> Point, UVPoint, Distance

# ----
# Measure Angle Turntable
# & Conversion to Steps
# Turntable Plane
# What happens in this section is in order to get the correct positionings
#  for the X Y coordinates the array is revolved so all the points are
#  represented along the ZY plane. This is because the camera is
# only taking photographs along this plane, we have already calculated
#  the rotation values from the array.
# Rotate points by angle
# Convert Radial Steps
# Convert Linear Steps
# Offset horizontal is 237.5 - envelope radius
# Convert Offset to Steps
subtraction = Subtraction(A=237.5, B=merge_8)
subtraction_2 = Subtraction(A=panel_26, B=subtraction)
pt_11 = ConstructPoint(XCoordinate=0, YCoordinate=-1000, ZCoordinate=0)
pt_12 = ConstructPoint(XCoordinate=0, YCoordinate=0, ZCoordinate=0)
pdecon = Deconstruct(Point=divide_2.Points)  # -> XComponent, YComponent, ZComponent
division_3 = Division(A=subtraction_2, B=0.0025)
pt_13 = ConstructPoint(XCoordinate=pdecon.XComponent, YCoordinate=pdecon.YComponent, ZCoordinate=0)
vec2pt = Vector2Pt(PointA=pt_11, PointB=pt_12, Unitize=False)  # -> Vector, Length
vec2pt_2 = Vector2Pt(PointA=pt_13, PointB=Point(0, 0, 0), Unitize=False)  # -> Vector, Length
xy_4 = XYPlane(Origin=Point(0, 0, 0))
angle = Angle(VectorA=vec2pt_2.Vector, VectorB=vec2pt.Vector, Plane=xy_4)  # -> Angle, Reflex
rotax = RotateAxis(Geometry=divide_2.Points, Angle=angle.Angle, Axis=move.Geometry)  # -> Geometry, Transform
division_4 = Division(A=rotax.Geometry, B=0.0025)
pdecon_2 = Deconstruct(Point=division_4)  # -> XComponent, YComponent, ZComponent
addition = Addition(A=pdecon_2.YComponent, B=division_3)
vdis = VectorDisplay(Anchor=pt_13, Vector=vec2pt_2.Vector)
deg = Degrees(Radians=angle.Angle)
division_5 = Division(A=deg, B=0.01125)
pt_14 = ConstructPoint(XCoordinate=division_5, YCoordinate=pdecon_2.YComponent, ZCoordinate=pdecon_2.ZComponent)

cullpt_2 = CullDuplicates(Points=flatten(divide_2.Points), Tolerance=5, CullMode=3)  # -> Points, Indices, Valence
srf_cp_5 = SurfaceClosestPoint(Point=cullpt_2.Points, Surface=offset)  # -> Point, UVPoint, Distance
vec2pt_3 = Vector2Pt(PointA=divide_2.Points, PointB=divide_3.Points, Unitize=False)  # -> Vector, Length
evalsrf_2 = EvaluateSurface(Surface=offset, Point=srf_cp_5.UVPoint)  # -> Point, Normal, Frame

# ----
# Servo Angle Calculation
# Draws lines from points to surface
# Offset for servo arm positioning
# Sets amplitude of vector. Camera Dist to Surface
# Display Tag
# Rounds to Int
# Measures angle between
# Vector & Vert
# Creates a vertical line to
# measure angle from
# Vector to move point
# Reversing number as servo
# is mounted backwards
# Position to place a text tag
# for debugging
rev = Reverse(Vector=evalsrf_2.Normal)
rev_2 = Reverse(Vector=evalsrf_2.Normal)
amp = Amplitude(Vector=rev_2, Amplitude=panel_26)
line_2 = LineSDL(Start=divide_2.Points, Direction=rev, Length=panel_22)  # -> flatten(Line)
vec = VectorXYZ(XComponent=0, YComponent=0, ZComponent=-50)  # -> Vector, Length
vdis_2 = VectorDisplay(Anchor=divide_2.Points, Vector=amp)
curvepoint = PointOnCurve(line_2, parameter=1)
curvepoint_2 = PointOnCurve(line_2, parameter=0)
move_2 = Move(Geometry=curvepoint_2, Motion=vec.Vector)  # -> Geometry, Transform
ln_4 = Line(StartPoint=curvepoint_2, EndPoint=move_2.Geometry)
angle_2 = Angle(VectorA=vec2pt_3.Vector, VectorB=ln_4)  # -> Angle, Reflex
vec_2 = VectorXYZ(XComponent=0, YComponent=10, ZComponent=-10)  # -> Vector, Length
deg_2 = Degrees(Radians=angle_2.Angle)
move_3 = Move(Geometry=curvepoint_2, Motion=vec_2.Vector)  # -> Geometry, Transform
round_2 = Round(Number=deg_2)  # -> Nearest, Floor, Ceiling
tag = TextTag(Location=move_3.Geometry, Text=round_2.Nearest)
addition_2 = Addition(A=round_2.Nearest, B=45)
subtraction_3 = Subtraction(A=180, B=addition_2)

subtraction_4 = Subtraction(A=pdecon_2.ZComponent, B=division)
rectangle_2 = Rectangle(Plane=evalsrf_2.Point, XSize=dom_3, YSize=dom_4, Radius=0)  # -> Rectangle, Length
vdis_3 = VectorDisplay(Anchor=srf_cp_5.Point, Vector=vec2pt_3.Vector)
addition_3 = Addition(A=pdecon_2.ZComponent, B=division)

# ----
# Machine Code Formatting
# Equation for formatting into the machine code to be sent to the arduino
# R = Rotation Steps
# Y = X Stepper Steps
# Z = Y Stepper Steps
# C = Servo Angle
expression_20 = Expression(
    R=division_5,
    Y=addition,
    Z=pdecon_2.ZComponent,
    C=addition_2,
    Expression="Format(\"{{{0:0},{1:0},{2:0},{3:0}}},\", R, Y, -Z, C)")
panel_35 = Panel(expression_20)

# ---- group: Save Scatter Data (continued)
text_data = Text(expression_20)
str = String(text_data)
txtwriter = VBScript(filePath=path, data=str, append=P, activate=write_txt, clearFile=clear)  # -> out, A; inputs data: list
# ---------- txtwriter: VB ----------
    If activate Then

      Dim i As Integer
      Dim aryText(4) As String

      aryText(0) = "Mary WriteLine"
      aryText(1) = "Had"
      aryText(2) = "Another"
      aryText(3) = "Little"
      aryText(4) = "One"

      ' the data is appended to the file. If file doesnt exist, a new file is created
      Dim objWriter As New System.IO.StreamWriter(filePath, append)

      For i = 0 To data.Count - 1
        objWriter.WriteLine(data(i))
      Next

      objWriter.Close()

    End If

    If clearFile Then
      Dim objWriter As New System.IO.StreamWriter(filePath, False)
      objWriter.Close()
    End If
# ---------- end txtwriter ----------
